# Grasshopper definition StructuralTest_Fin.gh (Grasshopper 1.0.7)
# plug-ins: Rhino.Inside for Autodesk Revit

gallery = ImageGallery(CycleDelay=30, Randomize=False, UseLocalImages=True, UseRemoteImages=True)
model = ModelCategoriesPicker({"HVAC ゾーン": -2008107, "MEP 製造用ダクト部品": -2008193, "MEP 製造用ハンガー部品": -2008203, "MEP 製造用収納部品": -2008212, "MEP 製造用配管部品": -2008208, "RVT リンク": -2001352, "エリア": -2003200, "カーテン グリッド": -2000173, "カーテン システム": -2000340, "カーテン パネル": -2000170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}, selected="構造フレーム": -2001320)
crv = Curve([<curve referenced from the Rhino model> x112])
element_type_picker = ElementTypePicker(
    model,
    {"M_W 形状 : W310X38.7": "6f0a4efb-a73b-47cb-9a7a-ae52aa37d4d5-94aa6176-6b0f-448e-a03e-8ebb563124cc-0001a31d", "S_B_H_1Sec : RCG3": "6f0a4efb-a73b-47cb-9a7a-ae52aa37d4d5-f2bcdec9-e7c9-45f9-a25d-7f2e6aa3b7f6-000343e9", "S_B_H_1Sec : RG3": "6f0a4efb-a73b-47cb-9a7a-ae52aa37d4d5-f2bcdec9-e7c9-45f9-a25d-7f2e6aa3b7f6-000343df", "S_B_H_1Sec : RG3a": "6f0a4efb-a73b-47cb-9a7a-ae52aa37d4d5-f2bcdec9-e7c9-45f9-a25d-7f2e6aa3b7f6-000343dd", "S_B_H_1Sec : SB19": "6f0a4efb-a73b-47cb-9a7a-ae52aa37d4d5-f2bcdec9-e7c9-45f9-a25d-7f2e6aa3b7f6-000343e7", "S_B_H_1Sec : SB28": "6f0a4efb-a73b-47cb-9a7a-ae52aa37d4d5-f2bcdec9-e7c9-45f9-a25d-7f2e6aa3b7f6-000343e1", "S_B_H_1Sec : SB29": "6f0a4efb-a73b-47cb-9a7a-ae52aa37d4d5-f2bcdec9-e7c9-45f9-a25d-7f2e6aa3b7f6-000343e5", "S_B_H_1Sec : SB30": "6f0a4efb-a73b-47cb-9a7a-ae52aa37d4d5-f2bcdec9-e7c9-45f9-a25d-7f2e6aa3b7f6-000343ed", "S_B_H_1Sec : SB40": "6f0a4efb-a73b-47cb-9a7a-ae52aa37d4d5-f2bcdec9-e7c9-45f9-a25d-7f2e6aa3b7f6-000343eb", "S_B_H_1Sec : SB41": "6f0a4efb-a73b-47cb-9a7a-ae52aa37d4d5-f2bcdec9-e7c9-45f9-a25d-7f2e6aa3b7f6-000343e3", "S_B_H_1Sec : SB49": "6f0a4efb-a73b-47cb-9a7a-ae52aa37d4d5-f2bcdec9-e7c9-45f9-a25d-7f2e6aa3b7f6-000343ef", "S_B_Pipe : SB31": "6f0a4efb-a73b-47cb-9a7a-ae52aa37d4d5-f2bcdec9-e7c9-45f9-a25d-7f2e6aa3b7f6-0003475a", "S_B_Pipe : T1": "6f0a4efb-a73b-47cb-9a7a-ae52aa37d4d5-f2bcdec9-e7c9-45f9-a25d-7f2e6aa3b7f6-0003475c", "S_B_Pipe : V21": "6f0a4efb-a73b-47cb-9a7a-ae52aa37d4d5-f2bcdec9-e7c9-45f9-a25d-7f2e6aa3b7f6-0003475e"}, selected="S_B_Pipe : V21")
id = Guid(crv)
getparam = GetElementParameter(Element=element_type_picker, ParameterKey="Id")
txt = Text(id)
run = Button()

# ----
# Color Format
# Input
data = Data(1)
# Method
data_2 = Data(1)
# Output
data_3 = Data(1)
# Display
data_4 = Data(1)
# Unuse
data_5 = Data(1)

dam = DataDam(DataA=crv, DataD=txt, DataB=getparam, DataC=run, BufferDelay=10000000, BufferMode=0)  # -> DataA, DataD, DataB, DataC
panel = Panel("410755b1-224a-4c1e-a407-bf32fb45ea7e")
create_brace = GhPythonScript(L=dam.DataA, I=dam.DataD, T=dam.DataB, Bake=run)  # -> out, E, Id; inputs L: list of Line, I: list
# ---------- create_brace: Python ----------
__author__ = "ykish"
__version__ = "2021.06.13"


# Common-Language-Runtime module provided by IronPython
import clr

clr.AddReference('RhinoCommon')

# add reference to base system types e.g. Enum
clr.AddReference('System.Core')

# add reference to API provided by Rhino.Inside.Revit
clr.AddReference('RhinoInside.Revit')

# add reference to Revit API (two DLLs)
clr.AddReference('RevitAPI') 
clr.AddReference('RevitAPIUI')
# from System.Core DLL
from System import Enum, Action

# Rhino.Inside.Revit API
import RhinoInside
from RhinoInside.Revit import Revit, Convert

import rhinoscriptsyntax as rs
import Grasshopper
import Rhino
from Grasshopper.Kernel import GH_RuntimeMessageLevel as RML

# add extensions methods as well
# this allows calling .ToXXX() convertor methods on Revit objects
clr.ImportExtensions(Convert.Geometry)

# Revit API
#from Autodesk.Revit import DB
from Autodesk.Revit import UI
from Autodesk.Revit.DB import Transaction, Element, ElementId, BuiltInCategory, DirectShape, FilteredElementCollector,FamilySymbol,FamilyInstance,Structure,Line,BuiltInParameter

#Linq
import System
clr.ImportExtensions(System.Linq)

def show_warning(msg):
    ghenv.Component.AddRuntimeMessage(RML.Warning, msg)

def show_error(msg):
    ghenv.Component.AddRuntimeMessage(RML.Error, msg)

def show_remark(msg):
    ghenv.Component.AddRuntimeMessage(RML.Remark, msg)


def create_brace(doc, lines):
    braces = []
    ids = []
    level = doc.ActiveView.GenLevel
    fsymbol = doc.GetElement(ElementId(T))
    if fsymbol.IsActive is False:
        fsymbol.Activate()
    if Bake == False:

        for i in range(len(lines)):
            line = lines[i]
            brace = doc.Create.NewFamilyInstance(Line.GetEndPoint(line,0), fsymbol, level, Structure.StructuralType.Brace)
            braceCurve1 = brace.Location
            braceCurve1.Curve = line;

        
            elem_param = brace.get_Parameter(BuiltInParameter.ALL_MODEL_INSTANCE_COMMENTS)
            elem_param.Set(ApplicationId)
            
            elem_param = brace.get_Parameter(BuiltInParameter.ALL_MODEL_MARK)
            elem_param.Set(I[i])

            braces.append(brace)
            ids.append(brace.Id)

    return braces, ids

def get_symbol(doc):
    symbols = []
    
    allcollector = DB.FilteredElementCollector(doc).OfClass(DB.FamilySymbol)
    allelementlist = allcollector.ToElementIds()
    symbols = allcollector.ToElements()

    for i in symbols:
        if DB.Element.Name.GetValue(i) == T:
            fsymbol = i

def convert_lines():
    lines = []
    for line in L:
        l = RhinoInside.Revit.Convert.Geometry.GeometryEncoder.ToLine(line)
        lines.append(l)
    return lines

doc = Revit.ActiveDBDocument
ApplicationId = ghenv.Component.ComponentGuid.ToString()
ApplicationDataId = ghenv.Component.InstanceGuid.ToString()

lines = convert_lines()
ids = []
braces = []
isCreated = False

if ghenv.Component.RunCount == 1:
    with Transaction(doc, ghenv.Component.NickName) as trans:
        trans.Start()
        
        with FilteredElementCollector(doc).OfClass(FamilyInstance).WhereElementIsNotElementType() as collector:
            #E = collector.ToElements()
            els = collector.ToElements().Where(lambda x: x.get_Parameter(BuiltInParameter.ALL_MODEL_INSTANCE_COMMENTS).AsString() == ApplicationId).ToList[Element]()
            #update
            if len(els) >0:
                isCreated = True
            
            for e in els:

                for i in range(len(I)):
                    id = I[i]
                    if id == e.get_Parameter(BuiltInParameter.ALL_MODEL_MARK).AsString():
                        
                        braceCurve1 = e.Location
                        braceCurve1.Curve = lines[i];
            braces = els
            ids  = braces.Select(lambda x: x.Id).ToList[ElementId]()
        trans.Commit()

if L is not None and isCreated is False:
    with Transaction(doc, ghenv.Component.NickName) as trans:
        trans.Start()

        braces, ids = create_brace(doc,lines)

        trans.Commit()
        
        

E = braces
Id = ids
# ---------- end create_brace ----------
panel_2 = Panel(create_brace.E)
dam_2 = DataDam(DataA=create_brace.Id, BufferDelay=10000000, BufferMode=0)
data_6 = Data(dam_2)
allow_end_joins = GhPythonScript(JS=Toggle(False), JE=Toggle(False))  # -> OB; inputs JS: Boolean, JE: Boolean
# ---------- allow_end_joins: Python ----------
import clr
clr.AddReference('System.Core')
clr.AddReference('RhinoInside.Revit')
clr.AddReference('RevitAPI') 
clr.AddReference('RevitAPIUI')

from System import Enum

import rhinoscriptsyntax as rs
import Rhino
import RhinoInside
import Grasshopper
from Grasshopper.Kernel import GH_RuntimeMessageLevel as RML
from RhinoInside.Revit import Revit, Convert
# add extensions methods as well
# this allows calling .ToXXX() convertor methods on Revit objects
clr.ImportExtensions(Convert.Geometry)
from Autodesk.Revit import DB

# active Revit verison
REVIT_VERSION = Revit.ActiveUIApplication.Application.VersionNumber

# access the active document object
doc = Revit.ActiveDBDocument

def show_warning(msg):
    ghenv.Component.AddRuntimeMessage(RML.Warning, msg)

def show_error(msg):
    ghenv.Component.AddRuntimeMessage(RML.Error, msg)

def show_remark(msg):
    ghenv.Component.AddRuntimeMessage(RML.Remark, msg)

SFU = DB.Structure.StructuralFramingUtils

t = DB.Transaction(doc, 'Update End Joins')
t.Start()
try:
    if isinstance(E, DB.FamilyInstance):
        # if structural beam
        if True:
            for state, endidx in zip([JS, JE], [0, 1]):
                print(state, endidx)
                if state:
                    SFU.AllowJoinAtEnd(E, endidx)
                else:
                    SFU.DisallowJoinAtEnd(E, endidx)
    t.Commit()
except Exception as txn_err:
    show_error(str(txn_err))
    t.RollBack()
# ---------- end allow_end_joins ----------
create_brace_2 = GhPythonScript(L=dam.DataA, T=dam.DataB, Bake=run)  # -> out, E, Id; inputs L: list of Line; disabled
# ---------- create_brace_2: Python ----------
__author__ = "ykish"
__version__ = "2021.06.13"


# Common-Language-Runtime module provided by IronPython
import clr

clr.AddReference('RhinoCommon')

# add reference to base system types e.g. Enum
clr.AddReference('System.Core')

# add reference to API provided by Rhino.Inside.Revit
clr.AddReference('RhinoInside.Revit')

# add reference to Revit API (two DLLs)
clr.AddReference('RevitAPI') 
clr.AddReference('RevitAPIUI')
# from System.Core DLL
from System import Enum, Action

# Rhino.Inside.Revit API
import RhinoInside
from RhinoInside.Revit import Revit, Convert

import rhinoscriptsyntax as rs
import Grasshopper
import Rhino
from Grasshopper.Kernel import GH_RuntimeMessageLevel as RML

# add extensions methods as well
# this allows calling .ToXXX() convertor methods on Revit objects
clr.ImportExtensions(Convert.Geometry)

# Revit API
#from Autodesk.Revit import DB
from Autodesk.Revit import UI
from Autodesk.Revit.DB import Transaction, Element, ElementId, BuiltInCategory, DirectShape, FilteredElementCollector,FamilySymbol,FamilyInstance,Structure,Line,BuiltInParameter

#Linq
import System
clr.ImportExtensions(System.Linq)

def show_warning(msg):
    ghenv.Component.AddRuntimeMessage(RML.Warning, msg)

def show_error(msg):
    ghenv.Component.AddRuntimeMessage(RML.Error, msg)

def show_remark(msg):
    ghenv.Component.AddRuntimeMessage(RML.Remark, msg)


def create_brace(doc, lines):
    braces = []
    ids = []
    level = doc.ActiveView.GenLevel
    fsymbol = doc.GetElement(ElementId(T))
    if fsymbol.IsActive is False:
        fsymbol.Activate()
    if Bake == False:
        i = 0
        for line in lines:
            brace = doc.Create.NewFamilyInstance(Line.GetEndPoint(line,0), fsymbol, level, Structure.StructuralType.Brace)
            braceCurve1 = brace.Location
            braceCurve1.Curve = line;

        
            elem_param = brace.get_Parameter(BuiltInParameter.ALL_MODEL_INSTANCE_COMMENTS)
            elem_param.Set(ApplicationId)
            
            elem_param = brace.get_Parameter(BuiltInParameter.ALL_MODEL_MARK)
            elem_param.Set(I[i])

            braces.append(brace)
            ids.append(brace.Id)
            i = i+1
    return braces, ids

def get_symbol(doc):
    symbols = []
    
    allcollector = DB.FilteredElementCollector(doc).OfClass(DB.FamilySymbol)
    allelementlist = allcollector.ToElementIds()
    symbols = allcollector.ToElements()

    for i in symbols:
        if DB.Element.Name.GetValue(i) == T:
            fsymbol = i

def convert_lines():
    lines = []
    for line in L:
        l = RhinoInside.Revit.Convert.Geometry.GeometryEncoder.ToLine(line)
        lines.append(l)
    return lines

doc = Revit.ActiveDBDocument
ApplicationId = ghenv.Component.ComponentGuid.ToString()
ApplicationDataId = ghenv.Component.InstanceGuid.ToString()

lines = convert_lines()
ids = []

# Delete previous run results

if ghenv.Component.RunCount == 1:
    
    with Transaction(doc, ghenv.Component.NickName) as trans:
        trans.Start()
        
        with FilteredElementCollector(doc).OfClass(FamilyInstance).WhereElementIsNotElementType() as collector:
            #E = collector.ToElements()
            doc.Delete(collector.ToElements().Where(lambda x: x.get_Parameter(BuiltInParameter.ALL_MODEL_INSTANCE_COMMENTS).AsString() == ApplicationId).Select(lambda x: x.Id).ToList[ElementId]())
            
            els = collector.ToElements()
            vals = []
            for e in els:
                
                vals.append( e.GetParameters('コメント')[0].AsString())
                vals.append( e.Symbol.Family.Name)
                vals.append( e.Name)
            E = vals
            
        trans.Commit()


if L is not None:
    with Transaction(doc, ghenv.Component.NickName) as trans:
        trans.Start()

        braces, ids = create_brace(doc,lines)

        trans.Commit()
        
        

E = braces
Id = ids
# ---------- end create_brace_2 ----------
panel_3 = Panel(create_brace.Id)
panel_4 = Panel(data_6)
